# Grasshopper definition spatial_agents_lattice_aggregation.gh (Grasshopper 1.0.7)
# plug-ins: GH_CPython

number_slider = Slider(1, range=0..1)
number_slider_2 = Slider(10, range=0..100)
gh_lattice = GhPythonScript(
    x=number_slider_2,
    y=number_slider_2,
    z=number_slider_2,
    x_unit=number_slider,
    y_unit=number_slider,
    z_unit=number_slider)  # -> out, lattice_unit, lattice_shape, lattice_cell_indices, lattice_cell_centroids; inputs x: Int32, y: Int32, z: Int32
# ---------- gh_lattice: Python ----------
__author__ = "shervinazadi"
__version__ = "2020.09.24"

import Rhino.Geometry as rg

centroids = []
indices = []
for zi in range(z+1):
    for yi in range(y+1):
        for xi in range(x+1):
            point = rg.Point3d(xi*x_unit,yi*y_unit,zi*z_unit)
            centroids.append(point)
            indices.append((xi,yi,zi))



lattice_unit = (x_unit, y_unit, z_unit)
lattice_shape = (x+1,y+1,z+1)
lattice_bounds = [(0,0,0),(x,y,z)]
lattice_cell_indices = indices
lattice_cell_centroids = centroids
# ---------- end gh_lattice ----------
point_of_interest = Point(Point(13.35852162, 1.135341554, 0))
point_of_interest_2 = Point(Point(2.437036113, 3.589455651, 11.83173029))
distance_lattice = GhPythonScript(lattice_cell_centroids=gh_lattice.lattice_cell_centroids, interest_point=point_of_interest)  # -> out, lattice_values; inputs lattice_cell_centroids: list of Point3d, interest_point: Point3d
# ---------- distance_lattice: Python ----------
__author__ = "shervinazadi"
__version__ = "2020.09.24"

import Rhino.Geometry as rg

values = []
for cell in lattice_cell_centroids:
    dist = cell.DistanceTo(interest_point)
    values.append(dist)

lattice_values = values
# ---------- end distance_lattice ----------
distance_lattice_2 = GhPythonScript(lattice_cell_centroids=gh_lattice.lattice_cell_centroids, interest_point=point_of_interest_2)  # -> out, lattice_values; inputs lattice_cell_centroids: list of Point3d, interest_point: Point3d; same code as distance_lattice
entwine = Entwine(Branch00=distance_lattice.lattice_values, Branch01=distance_lattice_2.lattice_values, FlattenInputs=True)
merge = Merge(Data1=Slider(0.5, range=0..1), Data2=Slider(0.5, range=0..1))
aggregate_lattice = AggregateLattice(input=Button(), lattice_shape=gh_lattice.lattice_shape, lattice_values=entwine, lattice_weights=merge)  # -> output, lattice_values; inputs input: list, lattice_shape: list, lattice_values: list, lattice_weights: list
#   port input: [required] - [type = int] - [default = None] Descripe your input here * bullet point. * bullet point
#   port output: indicate your output description here. refers to a new line.
# ---------- aggregate_lattice: Python ----------
# -*- coding: utf-8 -*-
""" 
Python Script
Created on  Thursday September 2020 09:25:19 
@author:  shervinazadi 
"""

import numpy as np
import topogenesis as tg

lattices = []
# normalization loop
for values in lattice_values:
    # convert to numpy array
    a_values = np.array(values)
    
    # normalization of values
    max_values = np.max(a_values)
    min_values = np.min(a_values)
    normalized_values = (a_values - min_values) / (max_values - min_values)
    
    # convert to lattice
    norm_shaped_values = normalized_values.reshape(lattice_shape)
    lattice = tg.to_lattice(norm_shaped_values, np.array([0,0,0]))
    
    lattices.append(lattice)

# normalize weights
weights = np.array(lattice_weights)
weights /= np.sum(weights)
'''
 The aggregation algorithm is based on Fuzzy Logics framework that is introduced, and generalized in Pirouz Nourian dissertation: section 5.7.3, pp. 201-208, eq. 57
you can refer to it like this:

P. Nourian, “Configraphics: Graph Theoretical Methods for Design and Analysis of Spatial Configurations,” Doi.Org, vol. 6, no. 14. pp. 1–348, 2016, url. ISBN-13 15) 978-94-6186-720-9

'''
# initialize the aggregated lattice
agg_lattice = lattices[0] * 0 + 1
# aggregation loop
for lat,w in zip(lattices, weights.tolist()):
    agg_lattice *= np.power(lat, w)

lattice_values = agg_lattice.flatten().tolist()
# ---------- end aggregate_lattice ----------
construct_lattice = ConstructLattice(input=Button(), lattice_shape=gh_lattice.lattice_shape, lattice_values=entwine)  # -> output; inputs input: list, lattice_shape: list, lattice_values: list
#   port input: [required] - [type = int] - [default = None] Descripe your input here * bullet point. * bullet point
#   port output: indicate your output description here. refers to a new line.
# ---------- construct_lattice: Python ----------
# -*- coding: utf-8 -*-
""" 
Python Script
Created on  Thursday September 2020 09:25:19 
@author:  shervinazadi 
"""

import numpy as np
import topogenesis as tg

lattices = []
for values in lattice_values:
    # convert to numpy array
    a_values = np.array(values)
    
    # normalization of values
    max_values = np.max(a_values)
    min_values = np.min(a_values)
    normalized_values = (a_values - min_values) / (max_values - min_values)
    
    # convert to lattice
    norm_shaped_values = normalized_values.reshape(lattice_shape)
    lattice = tg.to_lattice(norm_shaped_values, np.array([0,0,0]))
    
    lattices.append(lattice)
# ---------- end construct_lattice ----------
points_to_visualize = Data(gh_lattice.lattice_cell_centroids)
values_to_visualize = Data(aggregate_lattice.lattice_values)
python = GhPythonScript(values=values_to_visualize)  # -> min_val, max_val; inputs values: list
# ---------- python: Python ----------
__author__ = "shervinazadi"
__version__ = "2020.09.24"

max_val = max(values)
min_val = min(values)
# ---------- end python ----------
gradient = Gradient(
    LowerLimit=python.min_val,
    UpperLimit=python.max_val,
    Parameter=values_to_visualize,
    stops=[0: RGB(130, 218, 255), 1: RGB(220, 0, 40)])
preview = CustomPreview(Geometry=points_to_visualize, Material=gradient)
